# Grasshopper definition Karamba01.gh (Grasshopper 0.9.76)
# plug-ins: Biomorpher, Karamba

genes = GenePool(
    Decimals=2,
    Maximum=-0.2,
    Minimum=-2,
    Value=[-0.4699356432, -0.2900923377, -1.700760242, -1.20813955, -1.287842804, -0.9441309559, -1.237333821, -1.825882731, -1.488092214, -0.7877899075])
number_slider = Slider(0.6, range=0..1)
series = Series(Start=0, Step=1, Count=10)
neg = Negative(Value=number_slider)
pt = ConstructPoint(XCoordinate=series, YCoordinate=neg, ZCoordinate=0)
pt_2 = ConstructPoint(XCoordinate=series, YCoordinate=number_slider, ZCoordinate=0)
pt_3 = ConstructPoint(XCoordinate=series, YCoordinate=0, ZCoordinate=genes)
Z = UnitZ(Factor=Slider(-2.93, range=-10..0))
pline = PolyLine(Vertices=pt, Closed=False)
item = ListItem(List=reverse(pt), Index=0, Wrap=True)
ln = Line(StartPoint=pt, EndPoint=pt_3)
item_2 = ListItem(List=pt, Index=0, Wrap=True)
pline_2 = PolyLine(Vertices=pt_3, Closed=False)
pline_3 = PolyLine(Vertices=pt_2, Closed=False)
item_3 = ListItem(List=reverse(pt_2), Index=0, Wrap=True)
ln_2 = Line(StartPoint=pt_2, EndPoint=pt_3)
item_4 = ListItem(List=pt_2, Index=0, Wrap=True)
loads = LoadsKaramba(ForceVector=Z, Local=True, PosInd=pt_3, LCase=0, mode="Point")
loads_2 = LoadsKaramba(Vector=Vector(0, 0, -1), LCase=0, mode="Gravity")
explode = Explode(Curve=pline, Recursive=True)  # -> Segments, Vertices
explode_2 = Explode(Curve=pline_3, Recursive=True)  # -> Segments, Vertices
explode_3 = Explode(Curve=pline_2, Recursive=True)  # -> Segments, Vertices
supp = SupportKaramba(PosInd=[item_2, item], menu=[buttons(on, on, on, off, off, off)])
supp_2 = SupportKaramba(PosInd=[item_4, item_3], menu=[buttons(on, on, on, off, off, off)])
ln_3 = Line(StartPoint=pt, EndPoint=pt_2)
linetobeam = LineToBeamKaramba(
    Line=flatten([explode_2.Segments, ln_2, explode_3.Segments, explode.Segments, ln, ln_3]),
    New=True,
    Remove=True,
    LimitDistance_m=0.005)  # -> Points, Element, Info
assemble = AssembleModelKaramba(Elem=linetobeam.Element, Support=[supp_2, supp], Load=flatten([loads, loads_2]), LimitDistance_m=0.005)  # -> Model, Info, Mass_kg, CenterOfGravity
analyzethi = AnalyzeThIKaramba(Model=assemble.Model)  # -> CalculatedModel, MaximumDisplacement_m, ResultingForceOfGravity_kN, ElasticEnergy_kNm
modelview = ModelViewKaramba(Model=analyzethi.CalculatedModel, LoadCaseFactorsForLinearSuperposition=1, IndexIncrementOfVisibleLoadcase=0)  # -> Model, DeformedMesh, DeformedAxes, DeformedModel
beamview = BeamViewKaramba(Model=modelview.Model)  # -> Model, MeshesOfRenderedBeams, DeformedBeamAxes, LegendColors, LegendTags
addition = Addition(A=analyzethi.MaximumDisplacement_m, B=Slider(0, range=0..100))
biomorpher = Biomorpher(Genotype=genes, Geometry=beamview.MeshesOfRenderedBeams, Performance=addition)
