# Grasshopper definition boxes.gh (Grasshopper 0.9.76)
# plug-ins: Biomorpher

# In this example, genepools are used to
# create boxes which are then subtracted
# from the overall bounding box.
# 
# Double click on the Biomorpher component.
genes = GenePool(
    Decimals=2,
    Maximum=10,
    Minimum=0,
    Value=[6.357092263, 0.3140509786, 5.918581896, 3.461941676, 1.70659872, 9.43585539, 6.109922504, 8.685593707, 9.985970216, 9.08327211])
genes_2 = GenePool(
    Decimals=2,
    Maximum=10,
    Minimum=0,
    Value=[3.227461146, 7.212305504, 0.4300765158, 5.366381423, 4.055849178, 8.167640372, 7.62615119, 6.156200194, 1.191470394, 5.163587749])
genes_3 = GenePool(
    Decimals=2,
    Maximum=10,
    Minimum=0,
    Value=[9.496013311, 3.587522562, 7.394984502, 4.257684265, 0.6892668434, 1.342804279, 7.121998754, 0.7933088701, 9.744127046, 9.04739329])
genes_4 = GenePool(
    Decimals=2,
    Maximum=10,
    Minimum=0,
    Value=[0.5741240061, 8.185498103, 6.373337275, 7.762309476, 6.357301887, 9.813884211, 2.232481998, 8.473381274, 6.36042596, 8.182920045])
genes_5 = GenePool(
    Decimals=2,
    Maximum=10,
    Minimum=0,
    Value=[6.505788525, 1.54564766, 6.184960579, 9.729392023, 7.754915476, 3.704813102, 0.7912306544, 4.389427513, 7.603899209, 1.343565427])
genes_6 = GenePool(
    Decimals=2,
    Maximum=10,
    Minimum=0,
    Value=[9.612624051, 6.361375164, 3.145312044, 6.131124869, 8.095650125, 2.779569702, 2.929066477, 1.650897631, 8.615273906, 0.3737944405])
dom = ConstructDomain(DomainStart=genes_5, DomainEnd=genes_6)
dom_2 = ConstructDomain(DomainStart=genes_3, DomainEnd=genes_4)
dom_3 = ConstructDomain(DomainStart=genes, DomainEnd=genes_2)
box = DomainBox(Base=PlaneXY(0, 0, 0), X=dom_3, Y=dom_2, Z=dom)
bbox = BoundingBox(Content=box, Plane=PlaneXY(0, 0, 0), UnionBox=True)  # -> Box, Box_2
volume = Volume(Geometry=bbox.Box)  # -> Volume, Centroid
scale = Scale(Geometry=bbox.Box, Center=volume.Centroid, Factor="0.9")  # -> Geometry, Transform
number_slider = Slider(64, range=0..254)
number_slider_2 = Slider(33, range=0..254)
number_slider_3 = Slider(193, range=0..254)
rgb = ColourRGB(Alpha=255, Red=number_slider, Green=number_slider_2, Blue=number_slider_3)
sdiff = SolidDifference(BrepsA=scale.Geometry, BrepsB=box)
mcol = MeshColours(Mesh=sdiff, Colours=rgb)
preview = CustomPreview(Geometry=sdiff, Shader=rgb)
biomorpher = Biomorpher(
    Genome=[number_slider, number_slider_2, number_slider_3, genes, genes_2, genes_3, genes_4, genes_5, genes_6],
    Geometry=mcol)  # -> GenoGuids, Population, Historic, Clusters
id = Guid([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])
split = SplitList(List=id, Index=Slider(7, range=0..10))  # -> ListA, ListB
num = Number(Tree({0}: [0.2517068626, 0.1297726377, 0.7591281316, 0.6360039936, 0.03156502685, 0.5914129866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], {1}: [0.2517854561, 0.130054319, 0.758669757, 0.6357934662, 0.03164425566, 0.5919310549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], {2}: [0.2511523649, 0.1300658053, 0.7589658184, 0.6363554547, 0.03129835371, 0.5918636011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], {3}: [0.2513210355, 0.1299863771, 0.7587020231, 0.6359893533, 0.03197740267, 0.5914096684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], {4}: [0.2511391822, 0.1304712619, 0.7591663435, 0.6357092263, 0.03140509786, 0.5918581896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], {5}: [0.2518112042, 0.1301244024, 0.7584790487, 0.6356437467, 0.03207603857, 0.5917234238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]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))
id_2 = Guid([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])
biomorpherreader = BiomorpherReader(GenoGuids=id_2, Population=num, DesignID=Slider(4, range=0..10))
