# Grasshopper definition embryo01.gh (Grasshopper 0.9.76)
# plug-ins: Biomorpher, Fröbel, embryoA

block1 = Block1(InLength=1)  # -> OutBox, OutPlane1, OutPlane2
block2 = Block2(InLength=1, AddStoreys=1)  # -> OutBox, OutPlane1, OutPlane2, OutPlane3, OutPoint1
link2 = Link2()
g_slider7 = Slider(5.923, range=-10..10)
g_slider6 = Slider(7.393, range=-10..10)
g_slider5 = Slider(-6.124, range=-10..10)
g_slider4 = Slider(-5.833, range=-10..10)
g_slider3 = Slider(-2.863, range=-10..10)
g_slider2 = Slider(1.429, range=-10..10)
g_slider1 = Slider(-5.513, range=-10..10)
g_slider0 = Slider(1.681, range=-10..10)
xy = XYPlane(Origin=Point(0, 0, 0))
embryo = EmbryoSettings(
    Preview=True,
    SliderDomain=Domain(-10, 10),
    OneToOne=Toggle(True),
    GridX=120,
    GridY=120,
    RemoveDead=True,
    OnlyTerminals=False)
number_slider = Slider(354749, range=0..1000000)
parent_output = ParentOutput(O=xy)
embryo_2 = Embryo(
    Reset=Toggle(True),
    Sliders=8,
    Components=16,
    MetricGenes=2,
    TopologyGenes=2,
    FunctionGenes=2,
    Settings=embryo,
    RandomOveride=number_slider)  # -> Iterations, Components
get_geometry = GetGeometry()
mesh = MeshBrep(
    Brep=get_geometry,
    Settings={GridMaxCount=0, GridMinCount=16, JaggedSeams=False, MaxEdgeLength=0, MinEdgeLength=0.0001, MinTolerance=0, Refine=True, RefineAngle=0, RelativeTolerance=0.65, SimplePlanes=True, Tolerance=0})
biomorpher = Biomorpher(Genome=number_slider, Geometry=mesh)
