# Grasshopper definition embryo02.gh (Grasshopper 0.9.76)
# plug-ins: Biomorpher, Fröbel, embryoA

block1 = Block1(InTrans=0)  # -> OutBox, OutPlane1, OutPlane2
block2 = Block2(InTrans=1, InHeight=1)  # -> OutBox, OutPlane1, OutPlane2, OutPlane3, OutPoint1
block2_2 = Block2(InTrans=1, InHeight=1)  # -> OutBox, OutPlane1, OutPlane2, OutPlane3, OutPoint1
block2_3 = Block2(InTrans=1, InHeight=1)  # -> OutBox, OutPlane1, OutPlane2, OutPlane3, OutPoint1
link2 = Link2()
number_slider = Slider(4.1, range=0..100)
number_slider_2 = Slider(20, range=0..100)
genes = GenePool(
    Decimals=2,
    Maximum=5,
    Minimum=3,
    Value=[4.859458387, 4.789461302, 4.690281513, 4.643318794, 4.819712004, 3.877848865, 3.859749454, 4.687026572, 4.811662168, 4.407787522])
genes_2 = GenePool(
    Decimals=0,
    Maximum=20,
    Minimum=0,
    Value=[16.9935728, 13.11724759, 4.048740656, 3.193692308, 2.515126282, 15.50164865, 13.69101497, 16.67930671, 11.11007192, 15.31757419])
genes_3 = GenePool(
    Decimals=0,
    Maximum=4,
    Minimum=0,
    Value=[1.94824737, 0.139329207, 1.24032857, 0.889563629, 3.898022242, 0.1843552529, 1.380360144, 0.6886086977, 3.346204091, 1.048435856])
g_slider9 = Slider(4.41, range=3..4.5)
g_slider8 = Slider(4.5, range=3..4.5)
g_slider7 = Slider(4.5, range=3..4.5)
g_slider6 = Slider(3.86, range=3..4.5)
g_slider5 = Slider(3.88, range=3..4.5)
g_slider4 = Slider(4.5, range=3..4.5)
g_slider3 = Slider(4.5, range=3..4.5)
g_slider2 = Slider(4.5, range=3..4.5)
g_slider1 = Slider(4.5, range=3..4.5)
g_slider0 = Slider(4.5, range=3..4.5)
pt = ConstructPoint(XCoordinate=Slider(37.5, range=0..1000), YCoordinate=50, ZCoordinate=0)
embryo = EmbryoSettings(
    Preview=Toggle(False),
    SliderDomain=Domain(3, 4.5),
    OneToOne=Toggle(True),
    GridX=120,
    GridY=150,
    RemoveDead=Toggle(True),
    OnlyTerminals=False)
xz = XZPlane(Origin=Point(0, 0, 0))
xz_2 = XZPlane(Origin=pt)
parent_output = ParentOutput(O=[xz, xz_2])
parent_output_2 = ParentOutput(O=number_slider)
embryo_2 = Embryo(
    Reset=Toggle(True),
    Sliders=Slider(10, range=0..10),
    Components=Slider(16, range=0..100),
    MetricGenes=genes,
    TopologyGenes=genes_2,
    FunctionGenes=genes_3,
    Settings=embryo,
    RandomOveride=0)  # -> Iterations, Components
g_link2 = Link2(InPoint1=xz_2, InPoint2=xz)
g_block1 = Block1(InPlane=xz_2, InLength=g_slider4)  # -> OutBox, OutPlane1, OutPlane2
g_block2 = Block2(InPlane=g_block1.OutPlane2, InLength=g_slider5, AddStoreys=g_slider9)  # -> OutBox, OutPlane1, OutPlane2, OutPlane3, OutPoint1
g_block1_2 = Block1(InPlane=g_block2.OutPoint1, InLength=1)  # -> OutBox, OutPlane1, OutPlane2
g_block2_2 = Block2(InPlane=g_block2.OutPlane2, InLength=g_slider6, AddStoreys=number_slider)  # -> OutBox, OutPlane1, OutPlane2, OutPlane3, OutPoint1
g_block2_3 = Block2(InPlane=g_block2.OutPlane3, InLength=g_slider2, AddStoreys=g_slider3)  # -> OutBox, OutPlane1, OutPlane2, OutPlane3, OutPoint1
g_block2_4 = Block2(InPlane=g_block2_2.OutPlane3, InLength=1, AddStoreys=1)  # -> OutBox, OutPlane1, OutPlane2, OutPlane3, OutPoint1
g_block2_5 = Block2(InPlane=g_block2_3.OutPlane3, InLength=1, AddStoreys=1)  # -> OutBox, OutPlane1, OutPlane2, OutPlane3, OutPoint1
g_block1_3 = Block1(InPlane=g_block2_3.OutPlane2, InLength=g_slider1)  # -> OutBox, OutPlane1, OutPlane2
g_block2_6 = Block2(InPlane=g_block2_3.OutPlane1, InLength=g_slider8, AddStoreys=g_slider0)  # -> OutBox, OutPlane1, OutPlane2, OutPlane3, OutPoint1
g_link2_2 = Link2(InPoint1=g_block2_5.OutPlane1, InPoint2=g_block2_2.OutPoint1)
g_block2_7 = Block2(InPlane=g_block2_5.OutPlane3, InLength=1, AddStoreys=1)  # -> OutBox, OutPlane1, OutPlane2, OutPlane3, OutPoint1
g_block2_8 = Block2(InPlane=g_block2_6.OutPlane1, InLength=1, AddStoreys=1)  # -> OutBox, OutPlane1, OutPlane2, OutPlane3, OutPoint1
g_block2_9 = Block2(InPlane=g_block1_3.OutPlane2, InLength=g_slider7, AddStoreys=1)  # -> OutBox, OutPlane1, OutPlane2, OutPlane3, OutPoint1
g_block2_10 = Block2(InPlane=g_block2_9.OutPlane1, InLength=1, AddStoreys=1)  # -> OutBox, OutPlane1, OutPlane2, OutPlane3, OutPoint1
g_block1_4 = Block1(InPlane=g_block2_10.OutPlane3, InLength=1)  # -> OutBox, OutPlane1, OutPlane2
get_geometry = GetGeometry(G=[g_link2, g_block1.OutBox, g_block2.OutBox, g_block2_3.OutBox, g_block2_6.OutBox, g_block1_3.OutBox, g_block2_2.OutBox, g_block2_9.OutBox, g_block2_5.OutBox, g_block2_10.OutBox, g_link2_2, g_block1_2.OutBox, g_block2_4.OutBox, g_block2_8.OutBox, g_block2_7.OutBox, g_block1_4.OutBox])
pi = Pi(Factor=Slider(0, range=0..1))
rotate = Rotate(Geometry=get_geometry, Angle=pi, Plane=PlaneXY(0, 0, 0))  # -> Geometry, Transform
geo = Geometry(rotate.Geometry)
number_slider_3 = Slider(55, range=0..254)
number_slider_4 = Slider(103, range=0..254)
smesh = SimpleMesh(Brep=geo)
preview = CustomPreview(Geometry=smesh, Shader=ColourSwatch(SwatchColor=RGBA(117, 117, 117, 107)))
rgb = ColourRGB(Alpha=255, Red=number_slider_4, Green=0, Blue=number_slider_3)
mcol = MeshColours(Mesh=smesh, Colours=rgb)
biomorpher = Biomorpher(Sliders=[genes, genes_2, genes_3, number_slider_4, number_slider_3], Geometry=mcol)
custom_mesh_settings = SettingsCustom(
    StitchSeams=True,
    SimplePlanes=False,
    Refine=True,
    MinCount=16,
    MaxCount=400,
    AspectRatio=20,
    MaxDistance=0,
    MaxAngle=20,
    MinEdge=0,
    MaxEdge=Slider(3, range=0..100))  # disabled
mesh = MeshBrep(Brep=geo, Settings=custom_mesh_settings)  # disabled
deletef = DeleteFaces()  # disabled
mjoin = MeshJoin(Meshes=mesh)  # disabled
swatch = ColourSwatch(SwatchColor=RGBA(0, 0, 0, 145))  # disabled
# Make some columns
cluster = Cluster(M=mjoin)  # disabled
preview_2 = CustomPreview(Geometry=cluster, Shader=swatch)  # disabled

# ==== cluster Cluster
M = ClusterInput()
facen = FaceNormals(Mesh=M)  # -> Centers, Normals
Z = UnitZ(Factor=1)
dprod = DotProduct(VectorA=facen.Normals, VectorB=Z, Unitize=True)
smaller = SmallerThan(FirstNumber=dprod, SecondNumber="-0.9")  # -> SmallerThan, OrEqualTo
panel = Panel("1.3")
dispatch = Dispatch(List=facen.Centers, DispatchPattern=smaller.SmallerThan)  # -> ListA, ListB
lng = ListLength(List=dispatch.ListA)
division = Division(A=lng, B=Slider(1.05, range=1..2))
reduce = RandomReduce(List=dispatch.ListA, Reduction=division, Seed=1)
pdecon = Deconstruct(Point=reduce)  # -> XComponent, YComponent, ZComponent
pt = ConstructPoint(XCoordinate=pdecon.XComponent, YCoordinate=pdecon.YComponent, ZCoordinate=Slider(0, range=-10..1))
ln = Line(StartPoint=reduce, EndPoint=pt)
len = Length(Curve=ln)
addition = Addition(A=len, B=Slider(0.01, range=0..0.01))
multiplication = Multiplication(A=addition, B=Slider(0.02, range=0..0.1))
mpipe = MeshPipe(Curve=ln, Radius=multiplication, Accuracy=0.2, Rotation=0, Segments=10, Caps=0)
M_2 = ClusterOutput(mpipe)
