# Grasshopper definition extrusions.gh (Grasshopper 0.9.76)
# plug-ins: Biomorpher

genes = GenePool(
    Decimals=2,
    Maximum=100,
    Minimum=0,
    Value=[22.22063651, 38.52414582, 54.60383302, 11.22899585, 77.06196592, 31.60730488, 61.69684314, 91.72358584, 57.98063919, 27.27443284, 50.15243084, 28.05095647, 37.48025983, 31.85244538, 57.69487259, 80.97452048, 38.28656638, 13.61021876, 12.86109494, 65.82144589])
genes_2 = GenePool(
    Decimals=2,
    Maximum=100,
    Minimum=0,
    Value=[3.135855944, 67.61663406, 42.4497539, 95.31439829, 65.07022839, 14.01476894, 20.72696617, 89.84810475, 47.51461788, 93.4360746, 2.700433842, 53.70055106, 21.1869883, 45.90489193, 13.36624557, 71.81157676, 17.81708342, 14.37625411, 1.378558359, 51.41398559])
# In this example, genepools are used to
# create planar curves that are then extruded.
# Double click on the biomorpher component to begin.
genes_3 = GenePool(
    Decimals=2,
    Maximum=100,
    Minimum=0,
    Value=[10.70450942, 70.38622832, 16.92987537, 77.84102648, 82.61061956, 26.72001518, 84.23811444, 8.609051857, 57.17942812, 82.5138114, 62.73633458, 83.22345253, 8.177820354, 70.97673433, 99.90751245, 58.82443822, 38.76960751, 35.64919451, 46.00062696, 23.32689056])
pt = ConstructPoint(XCoordinate=genes_3, YCoordinate=genes, ZCoordinate=0)
qt = QuadTree(Points=pt, Plane=PlaneXY(0, 0, 0), Square=False, Group=Slider(1, range=0..10))  # -> Quads, Points
runion = RegionUnion(Curves=qt.Quads)
fillet = Fillet(Curve=runion, Radius=Slider(8.4, range=0..10))
lng = ListLength(List=fillet)
split = SplitList(List=genes_2, Index=lng)  # -> ListA, ListB
Z = UnitZ(Factor=split.ListA)
extr = Extrude(Base=fillet, Direction=Z)
cap = CapHoles(Brep=extr)
smooth = SettingsQuality()
mesh = MeshBrep(Brep=cap, Settings=smooth)
lng_2 = ListLength(List=mesh)
random = Random(Range=Domain(0, 1), Number=lng_2, Seed=4)
random_2 = Random(Range=Domain(0, 1), Number=lng_2, Seed=3)
random_3 = Random(Range=Domain(0, 1), Number=lng_2, Seed=2)
mjoin = MeshJoin(Meshes=mesh)
frgb = ColourRGBF(Alpha=1, Red=random_3, Green=random_2, Blue=random)
mcol = MeshColours(Mesh=graft(mesh), Colours=graft(frgb))
biomorpher = Biomorpher(Genome=[genes_3, genes, genes_2], Geometry=mcol)  # -> Clusters, History
