# Grasshopper definition genepools.gh (Grasshopper 0.9.76)
# plug-ins: Biomorpher

genes = GenePool(
    Decimals=2,
    Maximum=100,
    Minimum=0,
    Value=[6.682461643, 17.60697352, 20.54211261, 97.71538032, 35.42861381, 74.03341279, 0.3804591486, 91.35709046, 2.471861896, 84.36364917])
genes_2 = GenePool(
    Decimals=2,
    Maximum=100,
    Minimum=0,
    Value=[13.29669697, 4.998711871, 13.7146296, 19.72997264, 80.01123535, 44.44273154, 41.01229051, 40.83150934, 37.00556575, 28.85151078])
genes_3 = GenePool(
    Decimals=2,
    Maximum=100,
    Minimum=0,
    Value=[62.7905187, 71.12641957, 55.03510854, 52.50468783, 40.76471163, 23.369254, 99.45945055, 38.90651173, 6.397468739, 88.29009439])
genes_4 = GenePool(
    Decimals=2,
    Maximum=100,
    Minimum=0,
    Value=[14.69970258, 14.71113112, 22.08364947, 80.23795717, 19.98817516, 48.66244269, 93.96751644, 12.61540461, 58.92304278, 20.09738433])
genes_5 = GenePool(
    Decimals=2,
    Maximum=100,
    Minimum=0,
    Value=[50.82924927, 90.61375898, 44.08021655, 3.958903814, 57.70896564, 55.86941161, 24.21270377, 63.75711302, 54.64333685, 13.23851008])
genes_6 = GenePool(
    Decimals=2,
    Maximum=100,
    Minimum=0,
    Value=[99.6897439, 59.49565212, 65.59009802, 84.36219729, 50.25617776, 35.55604207, 62.57186498, 68.03742478, 56.95066869, 12.05935982])
pt = ConstructPoint(XCoordinate=genes_4, YCoordinate=genes_5, ZCoordinate=genes_6)
pt_2 = ConstructPoint(XCoordinate=genes, YCoordinate=genes_2, ZCoordinate=genes_3)
series = Series(Start=0, Step=1, Count=10)
box = Box2Pt(PointA=pt_2, PointB=pt, Plane=PlaneXY(0, 0, 0))
bnd = Bounds(Numbers=series)
smesh = SimpleMesh(Brep=box)
dedomain = DeconstructDomain(Domain=bnd)  # -> Start, End
volume = Volume(Geometry=smesh)  # -> Volume, Centroid
gradient = Gradient(
    LowerLimit=dedomain.Start,
    UpperLimit=dedomain.End,
    Parameter=series,
    stops=[0: RGB(234, 38, 0), 0.25: RGB(234, 126, 0), 0.5: RGB(254, 244, 84), 0.75: RGB(173, 203, 249), 1: RGB(75, 107, 169)])
ma = MassAddition(Input=volume.Volume)  # -> Result, PartialResults
biomorpher = Biomorpher(Genome=[genes, genes_2, genes_3, genes_4, genes_5, genes_6], Geometry=smesh, Performance=ma.Result)
preview = CustomPreview(Geometry=smesh, Shader=gradient)
