# Grasshopper definition mobius.gh (Grasshopper 0.9.76)
# plug-ins: Biomorpher, MeshEdit Components, LunchBox, Weaverbird

# Simple mobius band that is discretised into hexgaonal cells.
# Requires Weaverbird and Lunchbox plug-ins to run.
number_slider = Slider(2, range=0..5)
number_slider_2 = Slider(3, range=2..10)
number_slider_3 = Slider(71, range=29..100)
mobius = MobiusSurface(
    UDivisions=100,
    VDivisions=100,
    RParameter=4,
    TParameter=number_slider,
    Scale=5,
    Domain1=Domain(-3.141592654, 3.141592654),
    Domain2=Domain(-1, 1))
hex = HexagonCells(Surface=mobius, UDivisions=number_slider_3, VDivisions=number_slider_2, TParameter=0.25)  # -> HexagonCells, Centers
number_slider_4 = Slider(0.5524, range=0..1)
number_slider_5 = Slider(0.5404, range=0..1)
number_slider_6 = Slider(0.1111, range=0..1)
number_slider_7 = Slider(0.2, range=0..10)
wbframe = WeaverbirdsPictureFrame(MeshPolylines=hex.HexagonCells, Distance=5, InsetType=0)
wbthicken = WeaverbirdsMeshThicken(MeshCurves=wbframe, Distance=number_slider_7, OffsetType=0)
frgb = ColourRGBF(Alpha=1, Red=number_slider_4, Green=number_slider_6, Blue=number_slider_5)
mcol = MeshColours(Mesh=wbthicken, Colours=frgb)
demesh = DeconstructMesh(Mesh=mcol)  # -> Vertices, Faces, Colours, Normals
lng = ListLength(List=demesh.Vertices)
# (Performance 'parameter names'
# will be picked up automatically)
lng_2 = ListLength(List=demesh.Faces)
area = MeshArea(Mesh=mcol)  # -> Area, Centroid

# ---- group: Try an initial population
num = Number(Tree({0}: [0.5408857505, 0.1111492396, 0.5519108169, 0.02117633797, 0.3976485253, 0.143302116, 0.5972544093], {1}: [0.3437965067, 0.2723337823, 0.9092076926, 0.03937453863, 0.1210074303, 0.3402529961, 0.6151411644], {2}: [0.539955386, 0.1104821568, 0.5523208445, 0.02250143888, 0.3975325036, 0.1426757156, 0.5971621371], {3}: [0.5412727104, 0.1112031759, 0.5519467895, 0.02143493296, 0.3978206756, 0.1431067752, 0.5975722793], {4}: [0.5401259556, 0.1096680314, 0.5520102372, 0.02272372617, 0.3983319004, 0.1420273914, 0.5975676009], {5}: [0.6809713779, 0.1452402238, 0.6894185534, 0.01589232034, 0.2457110998, 0.4464835474, 0.60735736]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))

# ----
biomorpher = Biomorpher(
    Genome=[number_slider_5, number_slider_6, number_slider_4, number_slider_7, number_slider, number_slider_2, number_slider_3],
    Geometry=mcol,
    Performance=[area.Area, lng, lng_2])  # -> GenoGuids, Population, Historic, Clusters
viewer = ParamViewer(biomorpher.Clusters)
split = SplitTree(Data=biomorpher.Historic, Masks=flatten("{0;1;?}"))  # -> Positive, Negative
id = Guid([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])
num_2 = Number(Tree({0}: [0.5408857505, 0.1111492396, 0.5519108169, 0.02117633797, 0.3976485253, 0.143302116, 0.5972544093], {1}: [0.3437965067, 0.2723337823, 0.9092076926, 0.03937453863, 0.1210074303, 0.3402529961, 0.6151411644], {2}: [0.539955386, 0.1104821568, 0.5523208445, 0.02250143888, 0.3975325036, 0.1426757156, 0.5971621371], {3}: [0.5412727104, 0.1112031759, 0.5519467895, 0.02143493296, 0.3978206756, 0.1431067752, 0.5975722793], {4}: [0.5401259556, 0.1096680314, 0.5520102372, 0.02272372617, 0.3983319004, 0.1420273914, 0.5975676009], {5}: [0.6809713779, 0.1452402238, 0.6894185534, 0.01589232034, 0.2457110998, 0.4464835474, 0.60735736]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))
biomorpherreader = BiomorpherReader(GenoGuids=id, Population=num_2, DesignID=Slider(45, range=0..99))
