# Grasshopper definition Ishigami.gh (Grasshopper 1.0.7)
# plug-ins: Human, Biomorpher

genes = GenePool(
    Decimals=0,
    Maximum=50,
    Minimum=0,
    Value=[49.75084217, 0.4735505519, 12.95326081, 22.76812113, 44.98075174, 16.09690811, 9.463784465, 32.0826277, 24.2497446, 39.21465868, 9.647627715, 5.973893531, 19.53399842, 41.84876037, 31.41555704, 17.14896235, 33.69133989, 20.08897463, 6.277753869, 27.77379648])
genes_2 = GenePool(
    Decimals=0,
    Maximum=50,
    Minimum=0,
    Value=[26.25420583, 11.13310162, 46.28351211, 35.01005985, 49.07024805, 39.51068474, 46.3303931, 12.3480302, 7.575654962, 34.32432093, 23.57239179, 32.34100617, 25.3527477, 6.679347158, 24.28553484, 35.30159821, 41.24936838, 10.14330701, 10.48642298, 43.56680908])
genes_3 = GenePool(Decimals=0, Maximum=25, Minimum=1, Value=[18.51126017, 22.82161472, 6.98326178, 18.25861025])
genes_4 = GenePool(Decimals=0, Maximum=50, Minimum=0, Value=[19.82358928, 31.06179748, 18.08336728, 45.31690988])
genes_5 = GenePool(Decimals=0, Maximum=50, Minimum=0, Value=[17.8582121, 12.44491705, 35.57878749, 14.56210204])
genes_6 = GenePool(Decimals=0, Maximum=30, Minimum=0, Value=[13.95222101, 11.58141766, 22.57170967, 8.964558819])
genes_7 = GenePool(
    Decimals=0,
    Maximum=50,
    Minimum=0,
    Value=[45.94627324, 11.99188822, 46.951519, 48.96750344, 6.972085472, 31.57458928, 36.10280876, 19.21719944, 1.438912916, 46.92894672])
genes_8 = GenePool(
    Decimals=0,
    Maximum=50,
    Minimum=0,
    Value=[15.76497928, 8.937378224, 41.26067897, 11.78784355, 25.90630446, 47.43491212, 38.77837738, 11.77238687, 46.08846891, 36.33933004])
genes_9 = GenePool(
    Decimals=0,
    Maximum=50,
    Minimum=0,
    Value=[34.51210098, 35.43258532, 14.45631862, 46.33216939, 33.13236606, 39.78137967, 10.27299774, 19.45004073, 43.61105009, 35.44744185])
genes_10 = GenePool(
    Decimals=0,
    Maximum=50,
    Minimum=0,
    Value=[40.34323253, 24.97416513, 49.54223134, 37.72799862, 18.62073581, 12.185813, 4.321788495, 29.19156083, 33.25753124, 4.907202743])
genes_11 = GenePool(
    Decimals=0,
    Maximum=50,
    Minimum=0,
    Value=[9.358888566, 43.29792927, 34.51652511, 22.89464256, 15.24681819, 9.145989054, 4.056230901, 44.19822617, 36.48861259, 38.19387537])
genes_12 = GenePool(
    Decimals=0,
    Maximum=50,
    Minimum=0,
    Value=[25.78372466, 11.48131482, 23.21389386, 1.280186072, 30.37883039, 10.56368793, 47.5855696, 0.6193496118, 15.88513738, 17.14070581])
genes_13 = GenePool(
    Decimals=0,
    Maximum=20,
    Minimum=5,
    Value=[11.39047746, 9.995830409, 12.6818448, 9.797441319, 10.23463323, 17.25224425, 7.833544065, 6.074804105, 17.93513232, 9.116147437])
genes_14 = GenePool(
    Decimals=0,
    Maximum=50,
    Minimum=0,
    Value=[43.16312363, 9.636816551, 28.46485563, 41.18126616, 20.34517903, 41.21417171, 0.8660602111, 41.56167606, 31.0353512, 23.98637701])
genes_15 = GenePool(
    Decimals=0,
    Maximum=50,
    Minimum=0,
    Value=[35.77514877, 4.152629189, 32.91142814, 5.467174724, 9.713717193, 28.86191771, 1.760271266, 48.26204527, 7.299168235, 8.107047886])
genes_16 = GenePool(
    Decimals=0,
    Maximum=10,
    Minimum=5,
    Value=[6.465024341, 5.365243888, 6.325642345, 6.616682543, 8.36056112, 9.270612054, 6.769177992, 6.847505405, 6.625892837, 7.440600404])
pt = ConstructPoint(XCoordinate=genes_7, YCoordinate=genes_8, ZCoordinate=0)
pt_2 = ConstructPoint(XCoordinate=genes_11, YCoordinate=genes_12, ZCoordinate=0)
X = UnitX(Factor=1)
pt_3 = ConstructPoint(XCoordinate=genes_4, YCoordinate=genes_5, ZCoordinate=0)
Y = UnitY(Factor=1)
pt_4 = ConstructPoint(XCoordinate=genes_14, YCoordinate=genes_15, ZCoordinate=0)
pt_5 = ConstructPoint(XCoordinate=genes_9, YCoordinate=genes_10, ZCoordinate=0)
rectangle = Rectangle(Plane=pt, XSize=Domain(-1, 1), YSize=Domain(-2, 2), Radius=0)  # -> Rectangle, Length
neg = Negative(Value=genes_3)
rectangle_2 = Rectangle(Plane=pt_5, XSize=Domain(-4, 4), YSize=Domain(-1, 1), Radius=0)  # -> Rectangle, Length
neg_2 = Negative(Value=genes_6)
line = LineSDL(Start=pt_4, Direction=Y, Length=genes_16)
dom = ConstructDomain(DomainStart=neg, DomainEnd=genes_3)
line_2 = LineSDL(Start=pt_2, Direction=X, Length=genes_13)
dom_2 = ConstructDomain(DomainStart=genes_6, DomainEnd=neg_2)
previewlw = CustomPreviewLineweights(Geometry=line, Shader=ColourSwatch(SwatchColor=RGB(0, 0, 0)), Thickness=Slider(1, range=0..10), Absolute=False)
rectangle_3 = Rectangle(Plane=pt_3, XSize=dom, YSize=dom_2, Radius=0)  # -> Rectangle, Length
previewlw_2 = CustomPreviewLineweights(Geometry=line_2, Shader=ColourSwatch(SwatchColor=RGB(0, 0, 0)), Thickness=Slider(5, range=0..10), Absolute=False)
srf = Surface(rectangle_3.Rectangle)
smesh = SimpleMesh(Brep=rectangle_3.Rectangle)
previewlw_3 = CustomPreviewLineweights(
    Geometry=rectangle.Rectangle,
    Shader=ColourSwatch(SwatchColor=RGB(102, 102, 102)),
    Thickness=Slider(1, range=0..10),
    Absolute=False)
pt_6 = ConstructPoint(XCoordinate=genes, YCoordinate=genes_2, ZCoordinate=0)
previewlw_4 = CustomPreviewLineweights(
    Geometry=rectangle_2.Rectangle,
    Shader=ColourSwatch(SwatchColor=RGB(0, 0, 0)),
    Thickness=Slider(1, range=0..10),
    Absolute=False)
Z = UnitZ(Factor=Slider(-1, range=-1..0))
surfacemap = SurfaceMapping(Mesh=smesh, Surface=srf)
lng = ListLength(List=pt_6)
random = Random(Range=Domain(3, 5), Number=lng, Seed=2)
random_2 = Random(Range=Domain(3, 5), Number=lng, Seed=2)
neg_3 = Negative(Value=random)
neg_4 = Negative(Value=random_2)
dom_3 = ConstructDomain(DomainStart=neg_3, DomainEnd=random)
dom_4 = ConstructDomain(DomainStart=neg_4, DomainEnd=random_2)
previewlw_5 = CustomPreviewLineweights(
    Geometry=rectangle_3.Rectangle,
    Shader=ColourSwatch(SwatchColor=RGB(0, 0, 0)),
    Thickness=Slider(1, range=0..1),
    Absolute=False)
move = Move(Geometry=surfacemap, Motion=Z)  # -> Geometry, Transform
planesrf = PlaneSurface(Plane=pt_6, XSize=dom_3, YSize=dom_4)
previewmat = CustomPreviewMaterials(Geometry=move.Geometry, DiffuseColor=RGB(255, 255, 255), DiffuseBitmap="E:\Documents\Materials\Plywood.jpg")
previewmat_2 = CustomPreviewMaterials(
    Geometry=planesrf,
    DiffuseColor=RGB(255, 255, 255),
    DiffuseBitmap="C:\Users\john\Pictures\tree2.png",
    TransparencyBitmap="C:\Users\john\Pictures\tree2-alpha.png")
biomorpher = Biomorpher(
    Genome=[genes_3, genes_4, genes_5, genes_6, genes_7, genes_8, genes_9, genes_10, genes_11, genes_12, genes_13, genes_14, genes_15, genes_16, genes, genes_2],
    Geometry=line_2)
