# Grasshopper definition Simple Test Biomorpher+.gh (Grasshopper 1.0.7)
# plug-ins: Biomorpher

number_slider = Slider(3, range=0..100)
number_slider_2 = Slider(7, range=0..10)
random = Random(Range=Domain(0, 1), Number=1, Seed=number_slider)
msphereex = MeshSphereEx(Base=PlaneXY(0, 0, 0), Radius=number_slider, Count=5)
number_slider_3 = Slider(12, range=0..100)
biomorpher = Biomorpher(
    Genome=number_slider,
    Geometry=msphereex,
    Performs=random,
    ClusterSelect=Slider(3, range=0..10),
    ClusterShow=Slider(6, range=0..10))
pt = ConstructPoint(XCoordinate=0, YCoordinate=0, ZCoordinate=0)
