# Grasshopper definition embryo(requiresFroebel).gh (Grasshopper 1.0.7)
# plug-ins: Biomorpher, Fröbel, MeshEdit Components, embryoA

block1 = Block1(InTrans=0)  # -> OutBox, OutPlane1, OutPlane2
block2 = Block2(InTrans=1, InHeight=1)  # -> OutBox, OutPlane1, OutPlane2, OutPlane3, OutPoint1
block2_2 = Block2(InTrans=1, InHeight=1)  # -> OutBox, OutPlane1, OutPlane2, OutPlane3, OutPoint1
block2_3 = Block2(InTrans=1, InHeight=1)  # -> OutBox, OutPlane1, OutPlane2, OutPlane3, OutPoint1
link2 = Link2()
# In this example, we combine Biomorpher
# with the plug-in Embryo, to evolve
# parametric models themselves.
number_slider = Slider(37.5, range=0..1000)
g_slider9 = Slider(4.32, range=3..4.5)
g_slider8 = Slider(4.05, range=3..4.5)
g_slider7 = Slider(4.5, range=3..4.5)
g_slider6 = Slider(3.59, range=3..4.5)
g_slider5 = Slider(3.49, range=3..4.5)
g_slider4 = Slider(3.88, range=3..4.5)
g_slider3 = Slider(4.48, range=3..4.5)
g_slider2 = Slider(3.51, range=3..4.5)
g_slider1 = Slider(3.11, range=3..4.5)
g_slider0 = Slider(4.13, range=3..4.5)
number_slider_2 = Slider(4.1, range=0..100)
number_slider_3 = Slider(20, range=0..100)
genes = GenePool(
    Decimals=2,
    Maximum=5,
    Minimum=3,
    Value=[4.130060174, 3.107586214, 3.507592066, 4.479952384, 3.88, 3.487269246, 3.59, 4.942675571, 4.053333405, 4.320061685])
genes_2 = GenePool(
    Decimals=0,
    Maximum=4,
    Minimum=0,
    Value=[1.28405075, 2.577908508, 2.402782546, 2.582457663, 1.939521377, 2.794079437, 1.787640781, 3.757170999, 0.3877778446, 3.773762181, 1.19227692, 2.256695344, 1.711830794, 2.319881638, 1.781649387, 0.1720701271])
genes_3 = GenePool(
    Decimals=0,
    Maximum=20,
    Minimum=0,
    Value=[16.02749422, 14.09014714, 3.233860975, 17.73119591, 4.164750503, 7.382878646, 17.2402243, 8.721065628, 19.90400694, 12.51281648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])
pt = ConstructPoint(XCoordinate=number_slider, YCoordinate=50, ZCoordinate=0)
embryo = EmbryoSettings(
    Preview=Toggle(False),
    SliderDomain=Domain(3, 4.5),
    OneToOne=Toggle(True),
    GridX=120,
    GridY=150,
    RemoveDead=Toggle(True),
    OnlyTerminals=False)
xz = XZPlane(Origin=Point(0, 0, 0))
xz_2 = XZPlane(Origin=pt)
parent_output = ParentOutput(O=[xz, xz_2])
parent_output_2 = ParentOutput(O=number_slider_2)
g_block2 = Block2(InPlane=xz_2, InLength=g_slider7, AddStoreys=number_slider_2)  # -> OutBox, OutPlane1, OutPlane2, OutPlane3, OutPoint1
g_block2_2 = Block2(InPlane=xz, InLength=g_slider2, AddStoreys=g_slider3)  # -> OutBox, OutPlane1, OutPlane2, OutPlane3, OutPoint1
embryo_2 = Embryo(
    Reset=Toggle(True),
    Sliders=Slider(10, range=0..10),
    Components=Slider(50, range=0..100),
    MetricGenes=genes,
    TopologyGenes=genes_3,
    FunctionGenes=genes_2,
    Settings=embryo,
    RandomOveride=0)  # -> Iterations, Components
g_link2 = Link2(InPoint1=xz, InPoint2=g_block2_2.OutPoint1)
g_block2_3 = Block2(InPlane=g_block2.OutPlane1, InLength=1, AddStoreys=1)  # -> OutBox, OutPlane1, OutPlane2, OutPlane3, OutPoint1
g_block2_4 = Block2(InPlane=g_block2.OutPlane2, InLength=1, AddStoreys=1)  # -> OutBox, OutPlane1, OutPlane2, OutPlane3, OutPoint1
g_block1 = Block1(InPlane=g_block2_2.OutPlane3, InLength=g_slider9)  # -> OutBox, OutPlane1, OutPlane2
g_block2_5 = Block2(InPlane=g_block2_2.OutPlane2, InLength=g_slider8, AddStoreys=g_slider0)  # -> OutBox, OutPlane1, OutPlane2, OutPlane3, OutPoint1
g_link2_2 = Link2(InPoint1=g_block2_3.OutPoint1, InPoint2=g_block2_3.OutPlane1)
g_link2_3 = Link2(InPoint1=g_block2.OutPlane3, InPoint2=g_block2_5.OutPoint1)
g_link2_4 = Link2(InPoint1=xz_2, InPoint2=g_block2_5.OutPlane2)
g_block1_2 = Block1(InPlane=g_block2_3.OutPlane2, InLength=1)  # -> OutBox, OutPlane1, OutPlane2
g_block2_6 = Block2(InPlane=g_block2_4.OutPoint1, InLength=1, AddStoreys=1)  # -> OutBox, OutPlane1, OutPlane2, OutPlane3, OutPoint1
g_block2_7 = Block2(InPlane=g_block1.OutPlane1, InLength=1, AddStoreys=1)  # -> OutBox, OutPlane1, OutPlane2, OutPlane3, OutPoint1
g_block1_3 = Block1(InPlane=g_block1.OutPlane2, InLength=1)  # -> OutBox, OutPlane1, OutPlane2
g_block2_8 = Block2(InPlane=g_block2_5.OutPlane1, InLength=g_slider6, AddStoreys=g_slider1)  # -> OutBox, OutPlane1, OutPlane2, OutPlane3, OutPoint1
g_block2_9 = Block2(InPlane=g_block2_5.OutPlane3, InLength=g_slider5, AddStoreys=g_slider4)  # -> OutBox, OutPlane1, OutPlane2, OutPlane3, OutPoint1
g_link2_5 = Link2(InPoint1=g_block2_6.OutPlane1, InPoint2=g_block2_6.OutPoint1)
g_link2_6 = Link2(InPoint1=g_block1_3.OutPlane2, InPoint2=g_block2_6.OutPlane3)
g_link2_7 = Link2(InPoint1=g_block2_7.OutPlane2, InPoint2=g_block2_9.OutPlane3)
g_link2_8 = Link2(InPoint1=g_block2_8.OutPoint1, InPoint2=g_block2.OutPoint1)
g_link2_9 = Link2(InPoint1=g_block2_2.OutPlane1, InPoint2=g_block2_9.OutPlane2)
g_block2_10 = Block2(InPlane=g_block2_7.OutPlane1, InLength=1, AddStoreys=1)  # -> OutBox, OutPlane1, OutPlane2, OutPlane3, OutPoint1
g_block2_11 = Block2(InPlane=g_block2_7.OutPlane3, InLength=1, AddStoreys=1)  # -> OutBox, OutPlane1, OutPlane2, OutPlane3, OutPoint1
g_block2_12 = Block2(InPlane=g_block1_3.OutPlane1, InLength=1, AddStoreys=1)  # -> OutBox, OutPlane1, OutPlane2, OutPlane3, OutPoint1
g_block2_13 = Block2(InPlane=g_block1_2.OutPlane2, InLength=1, AddStoreys=1)  # -> OutBox, OutPlane1, OutPlane2, OutPlane3, OutPoint1
g_block2_14 = Block2(InPlane=g_block1_2.OutPlane1, InLength=1, AddStoreys=1)  # -> OutBox, OutPlane1, OutPlane2, OutPlane3, OutPoint1
g_block2_15 = Block2(InPlane=g_block2_9.OutPlane1, InLength=1, AddStoreys=1)  # -> OutBox, OutPlane1, OutPlane2, OutPlane3, OutPoint1
g_block2_16 = Block2(InPlane=g_block2_9.OutPoint1, InLength=1, AddStoreys=1)  # -> OutBox, OutPlane1, OutPlane2, OutPlane3, OutPoint1
g_block2_17 = Block2(InPlane=g_block2_8.OutPlane2, InLength=1, AddStoreys=1)  # -> OutBox, OutPlane1, OutPlane2, OutPlane3, OutPoint1
g_link2_10 = Link2(InPoint1=g_block2_12.OutPoint1, InPoint2=g_block2_12.OutPlane2)
g_link2_11 = Link2(InPoint1=g_block2_13.OutPlane1, InPoint2=g_block2_14.OutPlane2)
g_link2_12 = Link2(InPoint1=g_block2_4.OutPlane3, InPoint2=g_block2_15.OutPlane3)
g_link2_13 = Link2(InPoint1=g_block2_15.OutPlane2, InPoint2=g_block2_15.OutPoint1)
g_link2_14 = Link2(InPoint1=g_block2_16.OutPlane3, InPoint2=g_block2_17.OutPoint1)
g_link2_15 = Link2(InPoint1=g_block2_16.OutPlane1, InPoint2=g_block2_8.OutPlane1)
g_block2_18 = Block2(InPlane=g_block2_11.OutPlane1, InLength=1, AddStoreys=1)  # -> OutBox, OutPlane1, OutPlane2, OutPlane3, OutPoint1
g_block2_19 = Block2(InPlane=g_block2_13.OutPlane3, InLength=1, AddStoreys=1)  # -> OutBox, OutPlane1, OutPlane2, OutPlane3, OutPoint1
g_block2_20 = Block2(InPlane=g_block2_15.OutPlane1, InLength=1, AddStoreys=1)  # -> OutBox, OutPlane1, OutPlane2, OutPlane3, OutPoint1
g_block1_4 = Block1(InPlane=g_block2_13.OutPlane2, InLength=1)  # -> OutBox, OutPlane1, OutPlane2
g_block2_21 = Block2(InPlane=g_block2_14.OutPlane1, InLength=1, AddStoreys=1)  # -> OutBox, OutPlane1, OutPlane2, OutPlane3, OutPoint1
g_block1_5 = Block1(InPlane=g_block2_14.OutPoint1, InLength=1)  # -> OutBox, OutPlane1, OutPlane2
g_block2_22 = Block2(InPlane=g_block2_16.OutPlane2, InLength=1, AddStoreys=1)  # -> OutBox, OutPlane1, OutPlane2, OutPlane3, OutPoint1
g_link2_16 = Link2(InPoint1=g_block2_11.OutPlane3, InPoint2=g_block2_21.OutPlane3)
g_link2_17 = Link2(InPoint1=g_block2_12.OutPlane1, InPoint2=g_block2_21.OutPoint1)
g_link2_18 = Link2(InPoint1=g_block2_14.OutPlane3, InPoint2=g_block2_22.OutPlane3)
g_link2_19 = Link2(InPoint1=g_block2_16.OutPoint1, InPoint2=g_block2_22.OutPlane2)
g_block1_6 = Block1(InPlane=g_block2_21.OutPlane2, InLength=1)  # -> OutBox, OutPlane1, OutPlane2
g_block2_23 = Block2(InPlane=g_block1_5.OutPlane1, InLength=1, AddStoreys=1)  # -> OutBox, OutPlane1, OutPlane2, OutPlane3, OutPoint1
g_link2_20 = Link2(InPoint1=g_block2_23.OutPlane1, InPoint2=g_block2_12.OutPlane3)
g_link2_21 = Link2(InPoint1=g_block2_23.OutPlane3, InPoint2=g_block2_22.OutPoint1)
get_geometry = GetGeometry(G=[g_block2_2.OutBox, g_block2_5.OutBox, g_link2_4, g_block2_9.OutBox, g_link2_9, g_block2_8.OutBox, g_link2, g_block2.OutBox, g_block1.OutBox, g_block2_17.OutBox, g_block2_16.OutBox, g_link2_15, g_link2_14, g_link2_8, g_link2_3, g_block1_3.OutBox, g_block2_15.OutBox, g_block2_7.OutBox, g_link2_13, g_block2_4.OutBox, g_link2_7, g_block2_3.OutBox, g_link2_2, g_block2_6.OutBox, g_block1_2.OutBox, g_block2_22.OutBox, g_block2_14.OutBox, g_link2_6, g_link2_12, g_link2_19, g_link2_5, g_block1_5.OutBox, g_block2_13.OutBox, g_block2_23.OutBox, g_link2_11, g_block2_21.OutBox, g_link2_18, g_block2_12.OutBox, g_link2_21, g_block2_11.OutBox, g_block1_4.OutBox, g_block2_20.OutBox, g_block2_19.OutBox, g_link2_17, g_link2_20, g_link2_10, g_link2_16, g_block1_6.OutBox, g_block2_18.OutBox, g_block2_10.OutBox])
pi = Pi(Factor=Slider(0, range=0..1))
rotate = Rotate(Geometry=get_geometry, Angle=pi, Plane=PlaneXY(0, 0, 0))  # -> Geometry, Transform
geo = Geometry(rotate.Geometry)
smesh = SimpleMesh(Brep=geo)
volume = MeshVolume(Mesh=smesh)  # -> Volume, Centroid
larger = LargerThan(FirstNumber=volume.Volume, SecondNumber=Slider(10000, range=0..10000))  # -> LargerThan, OrEqualTo
dispatch = Dispatch(List=smesh, DispatchPattern=larger.LargerThan)  # -> ListA, ListB
mcol = MeshColours(Mesh=dispatch.ListB, Colours=ColourSwatch(SwatchColor=RGB(255, 0, 0)))
mcol_2 = MeshColours(Mesh=dispatch.ListA, Colours=ColourSwatch(SwatchColor=RGB(48, 33, 33)))
num = Number(Tree({0}: [0.08694963906, 0.2915720582, 0.9321724772, 0.7896349415, 0.02190216678, 0.7881899838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], {1}: [0.06566499316, 0.03736237392, 0.03353249144, 0.9257668745, 0.5274363735, 0.650446798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], {2}: [0.3262264674, 0.9140376052, 0.6598325081, 0.2016317673, 0.7516992999, 0.0189338266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], {3}: [0.6001552658, 0.6458249179, 0.2007622706, 0.7957069924, 0.1673611152, 0.2869665731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], {4}: [0.8175321221, 0.4188992388, 0.04766172406, 0.7221879245, 0.2008255325, 0.1569569987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], {5}: [0.0536001297, 0.369945672, 0.7037764619, 0.9125202046, 0.4854861873, 0.0518057016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], {6}: [0.7372050601, 0.9744024118, 0.133575311, 0.2091987665, 0.3155177386, 0.400668435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], {7}: [0.9840167705, 0.6516756176, 0.1448861147, 0.09820992411, 0.5467824985, 0.412733061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], {8}: [0.6416600447, 0.08091126293, 0.8309926297, 0.3772908786, 0.8861833289, 0.0938257026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], {9}: [0.5331826646, 0.8370627155, 0.3565502411, 0.197136005, 0.6197143344, 0.8512522177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], {10}: [0.5700555162, 0.8394454484, 0.6849148086, 0.2660294968, 0.4773108505, 0.7384866833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], {11}: [0.8398068942, 0.07946733715, 0.638833585, 0.3984086171, 0.6466288141, 0.7597090354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]))
biomorpher = Biomorpher(Genome=[genes, genes_3, genes_2], Geometry=flatten([mcol_2, mcol]))  # -> GenoGuids, Population, Historic, Clusters
panel = Panel(num)
panel_2 = Panel(biomorpher.GenoGuids)
preview = CustomPreview(Shader=ColourSwatch(SwatchColor=RGBA(255, 255, 255, 98)))
