# Grasshopper definition 03 Vases.gh (Grasshopper 1.0.7)
# plug-ins: Biomorpher

genes = GenePool(
    Decimals=2,
    Maximum=2,
    Minimum=0.05,
    Value=[1.935849446, 0.0712354822, 1.308721136, 1.717113805, 1.901028629, 1.266500568])
pt = ConstructPoint(XCoordinate=0, YCoordinate=0, ZCoordinate=0)
Z = UnitZ(Factor=1)
line = LineSDL(Start=pt, Direction=Z, Length="10")
number_slider = Slider(10, range=3..20)
pframes = PerpFrames(Curve=line, Count=Slider(6, range=0..10), Align=True)  # -> Frames, Parameters
polygon = Polygon(Plane=pframes.Frames, Radius=genes, Segments=number_slider, FilletRadius=0)  # -> Polygon, Length
loft = Loft(Curves=polygon.Polygon, Options={Adjust=False, Closed=False, LoftEnds=0, LoftSimp=0, LoftType=0, Rebuild=10, Refit=0.01})
debrep = DeconstructBrep(Brep=loft)  # -> Faces, Edges, Vertices
number_slider_2 = Slider(0.3321, range=0..1)
number_slider_3 = Slider(0.642, range=0..1)
number_slider_4 = Slider(0.24, range=0..1)
area = Area(Geometry=loft)  # -> SurfaceArea, Centroid
variance = Variance(num=genes)
mesh_uv = MeshSurface(Surface=debrep.Faces, UCount="20", VCount="1", Overhang=True, Equalize=False)
frgb = ColourRGBF(Alpha=Slider(0.45, range=0..1), Red=number_slider_2, Green=number_slider_3, Blue=number_slider_4)
mcol = MeshColours(Mesh=mesh_uv, Colours=frgb)
medges = MeshEdges(Mesh=mcol)  # -> NakedEdges, InteriorEdges, NonManifoldEdges
join = JoinCurves(Curves=medges.NakedEdges, Preserve=False)
biomorpher = Biomorpher(
    Genome=[number_slider_4, number_slider_3, number_slider_2, genes, number_slider],
    Geometry=[mcol, join],
    Performs=[area.SurfaceArea, variance])

# ==== cluster Variance: Variance
num = ClusterInput()
num_2 = Number(num)
avr = Average(Input=num_2)
subtraction = Subtraction(A=avr, B=num_2)
lng = ListLength(List=num_2)
sqr = Square(Value=subtraction)
ma = MassAddition(Input=sqr)  # -> Result, PartialResults
division = Division(A=ma.Result, B=lng)
R = ClusterOutput(division)
