# Grasshopper definition BooleanBoxes.gh (Grasshopper 1.0.7)
# plug-ins: MeshEdit Components, Biomorpher

genes = GenePool(
    Decimals=2,
    Maximum=10,
    Minimum=0,
    Value=[6.74057477, 9.112913552, 0.1921118331, 6.024970001, 6.965098952, 4.729074945, 1.383919642, 5.701717644, 7.089041908, 5.780175713])
genes_2 = GenePool(
    Decimals=2,
    Maximum=10,
    Minimum=0,
    Value=[4.678136378, 3.732625881, 7.479683146, 0.3635431735, 5.72311505, 7.727550235, 2.134992411, 9.458046024, 1.115283762, 5.741448126])
genes_3 = GenePool(
    Decimals=2,
    Maximum=10,
    Minimum=0,
    Value=[9.320981302, 1.216174625, 0.6542334616, 4.678585136, 9.04359023, 6.790398833, 8.187833674, 4.423828695, 9.145024414, 3.791109051])
genes_4 = GenePool(
    Decimals=2,
    Maximum=10,
    Minimum=0,
    Value=[4.548501523, 3.183511818, 1.236590786, 0.4403733464, 2.272944149, 5.954130085, 1.466862923, 1.226803763, 3.430999109, 3.653650835])
genes_5 = GenePool(
    Decimals=2,
    Maximum=10,
    Minimum=0,
    Value=[6.224778144, 0.2483650484, 9.789852891, 3.702668186, 9.632538687, 2.778053215, 5.668697583, 3.288027408, 6.173697955, 6.315323765])
genes_6 = GenePool(
    Decimals=2,
    Maximum=10,
    Minimum=0,
    Value=[6.92241011, 1.016028161, 4.773248841, 6.93188093, 5.198727746, 5.524400145, 8.458680091, 5.513526697, 6.98137977, 0.1747001196])
dom = ConstructDomain(DomainStart=genes_5, DomainEnd=genes_6)
dom_2 = ConstructDomain(DomainStart=genes_3, DomainEnd=genes_4)
dom_3 = ConstructDomain(DomainStart=genes, DomainEnd=genes_2)
box = DomainBox(Base=PlaneXY(0, 0, 0), X=dom_3, Y=dom_2, Z=dom)
bbox = BoundingBox(Content=box, Plane=PlaneXY(0, 0, 0), UnionBox=True)  # -> Box, Box_2
volume = Volume(Geometry=bbox.Box)  # -> Volume, Centroid
scale = Scale(Geometry=bbox.Box, Center=volume.Centroid, Factor="0.9")  # -> Geometry, Transform
number_slider = Slider(115, range=0..254)
number_slider_2 = Slider(68, range=0..254)
number_slider_3 = Slider(150, range=0..254)
sdiff = SolidDifference(BrepsA=scale.Geometry, BrepsB=box)
rgb = ColourRGB(Alpha=255, Red=number_slider, Green=number_slider_2, Blue=number_slider_3)
mesh = MeshBrep(
    Brep=sdiff,
    Settings={GridMaxCount=0, GridMinCount=16, JaggedSeams=False, MaxEdgeLength=0, MinEdgeLength=0.0001, MinTolerance=0, Refine=True, RefineAngle=0, RelativeTolerance=0.65, SimplePlanes=True, Tolerance=0})
mjoin = MeshJoin(Meshes=mesh)
mcol = MeshColours(Mesh=mjoin, Colours=rgb)
num = Number(Tree({0}: [0.6541241271, 0.6960090947, 0.655669323, 0.3297932857, 0.1231674189, 0.149462456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], {1}: [0.1342055021, 0.227353497, 0.03073510855, 0.6662764655, 0.2770747926, 0.03492233624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], {2}: [0.4871715584, 0.9708778108, 0.1854579776, 0.3892826016, 0.566058988, 0.584700452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], {3}: [0.5284747279, 0.2674473283, 0.205211076, 0.2260298376, 0.3041465191, 0.9194827759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], {4}: [0.02222211613, 0.7353420051, 0.2031032817, 0.5257840583, 0.1266440307, 0.1629205417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], {5}: [0.1384193805, 0.1413312429, 0.322569037, 0.7582760643, 0.3988022364, 0.9348235512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]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))
volume_2 = MeshVolume(Mesh=mcol)  # -> Volume, Centroid
biomorpher = Biomorpher(
    Genome=[number_slider_3, number_slider_2, number_slider, genes, genes_2, genes_3, genes_4, genes_5, genes_6],
    MeshEs=mcol,
    Performance=volume_2.Volume,
    InitialPop=num)  # -> GenoGuids, Population, Historic, Clusters
