# Grasshopper definition EmbryoExample.gh (Grasshopper 0.9.76)
# plug-ins: Biomorpher, embryoA

pt = ConstructPoint(XCoordinate=0, YCoordinate=0, ZCoordinate=0)
pt_2 = ConstructPoint(XCoordinate=0, YCoordinate=0, ZCoordinate=0)
pt_3 = ConstructPoint(XCoordinate=0, YCoordinate=0, ZCoordinate=0)
box_corners = BoxCorners()  # -> CornerA, CornerB, CornerC, CornerD, CornerE, CornerF, CornerG, CornerH
# Try disabling this plane by 3 points
pl_3pt = Plane3Pt()
pl_3pt_2 = Plane3Pt()
box = Box2Pt(Plane=PlaneXY(0, 0, 0))
box_2 = CenterBox(Base=PlaneXY(0, 0, 0), X=1, Y=1, Z=1)
rotate = Rotate(Angle=1.570796327, Plane=PlaneXY(0, 0, 0))  # -> Geometry, Transform; disabled
genes = GenePool(
    Decimals=2,
    Maximum=10,
    Minimum=-10,
    Value=[-7.860560416, -10, 10, -10, -4.62, 8.128038979, 1.580234939, -7.740242992, 6.324476114, 3.573881673])
genes_2 = GenePool(
    Decimals=0,
    Maximum=100,
    Minimum=0,
    Value=[75, 85, 26.93050174, 63, 5.464858937, 69.48936101, 70.21927492, 34.6505983, 86.45685547, 64.26495573])
genes_3 = GenePool(
    Decimals=0,
    Maximum=100,
    Minimum=0,
    Value=[52.32644554, 4.691141101, 31.70713528, 27.669987, 93.66851528, 73.82461996, 66.35537886, 26.36240224, 39.80336489, 80.04746739])
g_slider19 = Slider(3.57, range=-10..10)
g_slider18 = Slider(6.32, range=-10..10)
g_slider17 = Slider(-7.74, range=-10..10)
g_slider16 = Slider(1.58, range=-10..10)
g_slider15 = Slider(8.13, range=-10..10)
g_slider14 = Slider(-4.62, range=-10..10)
g_slider13 = Slider(-10, range=-10..10)
g_slider12 = Slider(10, range=-10..10)
g_slider11 = Slider(-10, range=-10..10)
g_slider10 = Slider(-7.86, range=-10..10)
g_slider9 = Slider(3.57, range=-10..10)
g_slider8 = Slider(6.32, range=-10..10)
g_slider7 = Slider(-7.74, range=-10..10)
g_slider6 = Slider(1.58, range=-10..10)
g_slider5 = Slider(8.13, range=-10..10)
g_slider4 = Slider(-4.62, range=-10..10)
g_slider3 = Slider(-10, range=-10..10)
g_slider2 = Slider(10, range=-10..10)
g_slider1 = Slider(-10, range=-10..10)
g_slider0 = Slider(-7.86, range=-10..10)
# Embryo Settings
embryo = EmbryoSettings(
    Preview=Toggle(False),
    SliderDomain=Domain(-10, 10),
    OneToOne=Toggle(True),
    GridX=120,
    GridY=120,
    RemoveDead=True,
    OnlyTerminals=Toggle(True))
embryo_2 = Embryo(
    Reset=Toggle(True),
    Sliders=Slider(20, range=0..100),
    Components=Slider(31, range=0..1000),
    MetricGenes=genes,
    TopologyGenes=genes_2,
    FunctionGenes=genes_3,
    Settings=embryo,
    RandomOveride=0)  # -> Iterations, Components
g_pt = ConstructPoint(XCoordinate=0, YCoordinate=0, ZCoordinate=0)
g_pt_2 = ConstructPoint(XCoordinate=0, YCoordinate=0, ZCoordinate=0)
g_pt_3 = ConstructPoint(XCoordinate=0, YCoordinate=0, ZCoordinate=0)
g_pt_4 = ConstructPoint(XCoordinate=0, YCoordinate=0, ZCoordinate=0)
g_pt_5 = ConstructPoint(XCoordinate=0, YCoordinate=0, ZCoordinate=0)
g_pt_6 = ConstructPoint(XCoordinate=0, YCoordinate=0, ZCoordinate=0)
g_pt_7 = ConstructPoint(XCoordinate=0, YCoordinate=0, ZCoordinate=0)
g_pt_8 = ConstructPoint(XCoordinate=0, YCoordinate=0, ZCoordinate=0)
g_pt_9 = ConstructPoint(XCoordinate=0, YCoordinate=0, ZCoordinate=0)
g_pt_10 = ConstructPoint(XCoordinate=0, YCoordinate=0, ZCoordinate=0)
g_pt_11 = ConstructPoint(XCoordinate=0, YCoordinate=0, ZCoordinate=0)
g_pt_12 = ConstructPoint(XCoordinate=0, YCoordinate=0, ZCoordinate=0)
g_pt_13 = ConstructPoint(XCoordinate=0, YCoordinate=0, ZCoordinate=0)
g_pt_14 = ConstructPoint(XCoordinate=g_slider16, YCoordinate=g_slider8, ZCoordinate=0)
g_pt_15 = ConstructPoint(XCoordinate=g_slider6, YCoordinate=g_slider4, ZCoordinate=g_slider7)
g_pt_16 = ConstructPoint(XCoordinate=g_slider15, YCoordinate=g_slider19, ZCoordinate=g_slider14)
g_pt_17 = ConstructPoint(XCoordinate=g_slider18, YCoordinate=g_slider12, ZCoordinate=g_slider3)
g_pt_18 = ConstructPoint(XCoordinate=g_slider1, YCoordinate=g_slider0, ZCoordinate=g_slider2)
g_box = CenterBox(Base=PlaneXY(0, 0, 0), X=g_slider5, Y=g_slider9, Z=g_slider11)
g_box_2 = CenterBox(Base=g_pt_12, X=1, Y=1, Z=1)
g_box_3 = CenterBox(Base=g_pt_14, X=1, Y=1, Z=1)
g_box_4 = CenterBox(Base=g_pt_17, X=1, Y=1, Z=1)
g_box_5 = CenterBox(Base=g_pt_15, X=1, Y=1, Z=1)
g_box_corners = BoxCorners(Box=g_box)  # -> CornerA, CornerB, CornerC, CornerD, CornerE, CornerF, CornerG, CornerH
g_box_6 = CenterBox(Base=g_pt_18, X=g_slider13, Y=g_slider10, Z=g_slider17)
g_box_corners_2 = BoxCorners(Box=g_box_3)  # -> CornerA, CornerB, CornerC, CornerD, CornerE, CornerF, CornerG, CornerH
g_box_corners_3 = BoxCorners(Box=g_box_5)  # -> CornerA, CornerB, CornerC, CornerD, CornerE, CornerF, CornerG, CornerH
g_pl_3pt = Plane3Pt(PointA=g_box_corners.CornerF, PointB=g_box_corners.CornerD, PointC=g_box_corners.CornerA)
g_box_7 = CenterBox(Base=g_box_corners_3.CornerE, X=1, Y=1, Z=1)
g_pl_3pt_2 = Plane3Pt(PointA=g_pt_16, PointB=g_pl_3pt, PointC=g_box_corners_3.CornerD)
get_geometry = GetGeometry(G=[g_box, g_box_6, g_box_5, g_box_4, g_box_3, g_box_2, g_box_7])
# Clean geometry
clean = CleanTree(RemoveNulls=True, RemoveInvalid=True, RemoveEmpty=False, Tree=get_geometry)
# Boolean anything solid
cluster = Cluster(geo=clean)
dom = ConstructDomain(DomainStart=Slider(-83, range=-100..0), DomainEnd=Slider(86.79, range=0..100))
dom_2 = ConstructDomain(DomainStart=Slider(-50.232, range=-100..0), DomainEnd=Slider(50.09, range=0..100))
box_3 = DomainBox(Base=PlaneXY(0, 0, 0), X=dom, Y=dom_2, Z=Domain(0, 140))
# Post Production
bbox = BoundingBox(Content=cluster, Plane=PlaneXY(0, 0, 0), UnionBox=True)  # -> Box, Box_2
# Map to a target shape
boxmap = BoxMapping(Geometry=cluster, Source=bbox.Box, Target=box_3)  # -> Geometry, Transform
# GEA and Floor to Floor
panel = Panel("144000")
number_slider = Slider(100, range=0..100)
fastbrepvolume = FastBrepVolume(InputBrep=boxmap.Geometry)
multiplication = Multiplication(A=panel, B="3.6")
# Scale in Z to hit target volume
division = Division(A=multiplication, B=fastbrepvolume)
# Mesh the thing
custom_mesh_settings = SettingsCustom(
    StitchSeams=True,
    SimplePlanes=False,
    Refine=True,
    MinCount=Slider(0, range=0..100),
    MaxCount=400,
    AspectRatio=20,
    MaxDistance=0,
    MaxAngle=20,
    MinEdge=number_slider,
    MaxEdge=number_slider)
scale_nu = ScaleNU(Geometry=boxmap.Geometry, Plane=PlaneXY(0, 0, 0), ScaleX=1, ScaleY=1, ScaleZ=division)  # -> Geometry, Transform
mesh = MeshBrep(Brep=scale_nu.Geometry, Settings=custom_mesh_settings)
wires = BrepWireframe(Brep=scale_nu.Geometry, Density=-1)
mjoin = MeshJoin(Meshes=mesh)
preview = CustomPreview(Geometry=wires, Shader=ColourSwatch(SwatchColor=RGB(0, 0, 0)))
preview_2 = CustomPreview(Geometry=scale_nu.Geometry, Shader=ColourSwatch(SwatchColor=RGBA(255, 255, 255, 169)))
cluster_2 = Cluster_2(M=mjoin)
mcol = MeshColours(Mesh=mjoin, Colours=ColourSwatch(SwatchColor=RGBA(145, 145, 145, 132)))
mcol_2 = MeshColours(Mesh=cluster_2, Colours=ColourSwatch(SwatchColor=RGBA(0, 0, 0, 140)))
# Make some columns
preview_3 = CustomPreview(Geometry=cluster_2, Shader=ColourSwatch(SwatchColor=RGB(57, 11, 117)))
biomorpher = Biomorpher(Genome=[genes, genes_2, genes_3], Geometry=flatten([mcol_2, mcol]))  # -> GenoGuids, Population, Historic, Clusters

# ==== cluster Cluster
geo = ClusterInput()
geo_2 = Geometry(geo)
fastbrepvolume = FastBrepVolume(InputBrep=geo_2)
larger = LargerThan(FirstNumber=fastbrepvolume, SecondNumber="10")  # -> LargerThan, OrEqualTo
dispatch = Dispatch(List=geo_2, DispatchPattern=larger.LargerThan)  # -> ListA, ListB
cap = CapHoles(Brep=dispatch.ListA)
sunion = SolidUnion(Breps=flatten(cap))
R = ClusterOutput(sunion)

# ==== cluster Cluster_2
M = ClusterInput()
Z = UnitZ(Factor=1)
facen = FaceNormals(Mesh=M)  # -> Centers, Normals
dprod = DotProduct(VectorA=facen.Normals, VectorB=Z, Unitize=True)
smaller = SmallerThan(FirstNumber=dprod, SecondNumber="-0.9")  # -> SmallerThan, OrEqualTo
dispatch = Dispatch(List=facen.Centers, DispatchPattern=smaller.SmallerThan)  # -> ListA, ListB
pdecon = Deconstruct(Point=dispatch.ListA)  # -> XComponent, YComponent, ZComponent
pt = ConstructPoint(XCoordinate=pdecon.XComponent, YCoordinate=pdecon.YComponent, ZCoordinate=0)
ln = Line(StartPoint=dispatch.ListA, EndPoint=pt)
len = Length(Curve=ln)
addition = Addition(A=len, B=Slider(0.01, range=0..0.01))
multiplication = Multiplication(A=addition, B=Slider(0.02, range=0..0.1))
mpipe = MeshPipe(Curve=ln, Radius=multiplication, Accuracy=0.2, Rotation=0, Segments=10, Caps=0)
M_2 = ClusterOutput(mpipe)
