# Grasshopper definition KarambaExample.gh (Grasshopper 0.9.76)
# plug-ins: Biomorpher, Karamba

genes = GenePool(
    Decimals=3,
    Maximum=1,
    Minimum=0,
    Value=[0.8620030988, 0.9760204397, 0.4538633953, 0.7080701353, 0.4517569812, 0.2982092792, 0.2370993758, 0.2401458896, 0.3542198821, 0.5493417955])
genes_2 = GenePool(
    Decimals=3,
    Maximum=5,
    Minimum=0,
    Value=[2.994, 4.139, 0.6232640476, 2.368601909, 4.899726871, 1.757520685, 2.833668279, 4.890899747, 2.392596513, 0.5290668507])

# ---- group: Edge curves
crv = Curve(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)
crv_2 = Curve(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)

# ----
panel = Panel("""-5
5""")
Y = UnitY(Factor=panel)
end = EndPoints(Curve=[crv, crv_2])  # -> Start, End
divide = DivideCurve(Curve=crv, Count=10, Kinks=False)  # -> Points, Tangents, Parameters
divide_2 = DivideCurve(Curve=crv_2, Count=10, Kinks=False)  # -> Points, Tangents, Parameters
xz = XZPlane(Origin=Point(0, 0, 0))
move = Move(Geometry=graft(end.Start), Motion=Y)  # -> flatten(Geometry), Transform
ln = Line(StartPoint=divide.Points, EndPoint=divide_2.Points)

# ---- group: Support locations
pt = Point(move.Geometry)

# ---- group: Load locations
pt_2 = Point(end.End)

# ----
eval = EvaluateCurve(Curve=ln, Parameter=genes)  # -> Point, Tangent, Angle
Y_2 = UnitY(Factor=genes_2)
xz_2 = XZPlane(Origin=Point(0, 0, 0))
move_2 = Move(Geometry=eval.Point, Motion=Y_2)  # -> Geometry, Transform
mirror = Mirror(Geometry=move_2.Geometry, Plane=xz_2)  # -> Geometry, Transform
merge = Merge()
merge_2 = Merge(Data1=pt, Data2=move_2.Geometry, Data3=mirror.Geometry, Data4=pt_2, Data5=divide.Points, Data6=divide_2.Points)  # -> flatten(Result)

# ---- group: Show supports
msphereex = MeshSphereEx(Base=pt, Radius="0.75", Count=5)

# ----
nearn = NearestNeighborsKaramba(FromPoints=merge_2, ToPoints=merge_2, NumberOfNeighbors=Slider(3, range=0..10), LimitDistance=Slider(0, range=0..10))  # -> Line, Connectivity, Points
rdlines = RemoveDuplicateLinesKaramba(Line=flatten(nearn.Line), LimitDistance=0.005)  # -> OutLine, Info, Indexes
linetobeam = LineToBeamKaramba(Line=rdlines.OutLine, New=True, Remove=True, LimitDistance_m=0.005)  # -> Element, Points, Info
Z = UnitZ(Factor="-10")
supp = SupportKaramba(PosInd=pt, menu=[buttons(on, on, on, on, on, on)])
loads = LoadsKaramba(ForceVector=Z, Local=False, PosInd=pt_2, LCase=0, mode="Point")
crosecrselect = CrossSectionRangeSelectorKaramba(MaximumHeight_cm=-1, MaximumWidth_cm=-1, menu=[dropdown(2), dropdown(3), dropdown(4)])
item = ListItem(List=crosecrselect, Index="174", Wrap=True)
assemble = AssembleModelKaramba(Elem=linetobeam.Element, Support=supp, Load=loads, CrossSection=item, LimitDistance_m=0.005)  # -> Model, Info, Mass_kg, CenterOfGravity
analyzethii = AnalyzeThIIKaramba(Model=assemble.Model, LoadCase=-1, RTolerance=1e-07, MaxIterations=50, NoTensionalNII=False)  # -> CalculatedModel, MaximumDisplacement_m, ResultingForceOfGravity_kN, ElasticEnergy_kNm
analyzethi = AnalyzeThIKaramba(Model=assemble.Model)  # -> CalculatedModel, MaximumDisplacement_m, ResultingForceOfGravity_kN, ElasticEnergy_kNm
modelview = ModelViewKaramba(Model=analyzethi.CalculatedModel, LoadCaseFactorsForLinearSuperposition=1, IndexIncrementOfVisibleLoadcase=0)  # -> Model, DeformedMesh, DeformedAxes, DeformedModel
beamview = BeamViewKaramba(Model=modelview.Model)  # -> Model, MeshesOfRenderedBeams, DeformedBeamAxes, LegendColors, LegendTags
mjoin = MeshJoin(Meshes=msphereex)
mjoin_2 = MeshJoin(Meshes=beamview.MeshesOfRenderedBeams)

# ---- group: Convert to mm
multiplication = Multiplication(A=analyzethii.MaximumDisplacement_m, B=Slider(1000, range=0..1000))

# ----
mcol = MeshColours(Mesh=mjoin, Colours=ColourSwatch(SwatchColor=RGB(0, 0, 0)))
entwine = Entwine(Branch00=mjoin_2, Branch01=mcol, FlattenInputs=True)  # -> flatten(Result)
biomorpher = Biomorpher(Genome=genes, Geometry=entwine, Performance=multiplication)  # -> Clusters, Population, Historic, Clusters_2
