# Grasshopper definition LunchboxExample.gh (Grasshopper 0.9.76)
# plug-ins: Biomorpher, MeshEdit Components, LunchBox, Weaverbird

# Möbius band that is discretised into hexgaonal cells.
# Requires Weaverbird and Lunchbox plug-ins.
number_slider = Slider(4, range=0..5)
number_slider_2 = Slider(10, range=2..10)
number_slider_3 = Slider(67, range=29..100)
mobius = MobiusSurface(
    UDivisions=100,
    VDivisions=100,
    RParameter=4,
    TParameter=number_slider,
    Scale=5,
    Domain1=Domain(-3.141592654, 3.141592654),
    Domain2=Domain(-1, 1))
hex = HexagonCells(Surface=mobius, UDivisions=number_slider_3, VDivisions=number_slider_2, TParameter=0.25)  # -> HexagonCells, Centers
number_slider_4 = Slider(0.3344, range=0..1)
number_slider_5 = Slider(0.2717, range=0..1)
number_slider_6 = Slider(0.1005, range=0..1)
number_slider_7 = Slider(3.6, range=0..10)
wbframe = WeaverbirdsPictureFrame(MeshPolylines=hex.HexagonCells, Distance=5, InsetType=0)
wbthicken = WeaverbirdsMeshThicken(MeshCurves=wbframe, Distance=number_slider_7, OffsetType=0)
frgb = ColourRGBF(Alpha=1, Red=number_slider_4, Green=number_slider_6, Blue=number_slider_5)
mcol = MeshColours(Mesh=wbthicken, Colours=frgb)
argb = SplitARGB(Colour=frgb)  # -> Alpha, Red, Green, Blue
demesh = DeconstructMesh(Mesh=mcol)  # -> Vertices, Faces, Colours, Normals
ma = MassAddition(Input=[argb.Red, argb.Green, argb.Blue])  # -> Result, PartialResults
division = Division(A=ma.Result, B="3")
lng = ListLength(List=demesh.Vertices)
area = MeshArea(Mesh=mcol)  # -> Area, Centroid

# ---- group: Try an example initial population
num = Number(Tree({0}: [0.5408857505, 0.1111492396, 0.5519108169, 0.02117633797, 0.3976485253, 0.143302116, 0.5972544093], {1}: [0.3437965067, 0.2723337823, 0.9092076926, 0.03937453863, 0.1210074303, 0.3402529961, 0.6151411644], {2}: [0.539955386, 0.1104821568, 0.5523208445, 0.02250143888, 0.3975325036, 0.1426757156, 0.5971621371], {3}: [0.5412727104, 0.1112031759, 0.5519467895, 0.02143493296, 0.3978206756, 0.1431067752, 0.5975722793], {4}: [0.5401259556, 0.1096680314, 0.5520102372, 0.02272372617, 0.3983319004, 0.1420273914, 0.5975676009], {5}: [0.6809713779, 0.1452402238, 0.6894185534, 0.01589232034, 0.2457110998, 0.4464835474, 0.60735736]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))

# ----
biomorpher = Biomorpher(
    Genome=[number_slider_5, number_slider_6, number_slider_4, number_slider_7, number_slider, number_slider_2, number_slider_3],
    Geometry=mcol,
    Performance=[area.Area, lng, division])  # -> GenoGuids, Population, Historic, Clusters

# ---- group: Visualise Cluster Distribution
viewer = ParamViewer(biomorpher.Clusters)

# ---- group: Internalise these to store data
id = Guid(biomorpher.GenoGuids)
num_2 = Number(biomorpher.Population)
num_3 = Number(biomorpher.Historic)

# ---- group: Mask to identify a specific population
panel = Panel("{0;1;?}")

# ---- group: Example GUIDs
id_2 = Guid([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])

# ---- group: Example Population data
num_4 = Number(Tree({0}: [0.1890335497, 0.1242170113, 0.998752759, 0.1961316246, 0.5925103792, 0.3414337247, 0.7279842908], {1}: [0.2826036034, 0.117571215, 0.5675696918, 0.1912455085, 0.5924531562, 0.2334249886, 0.613455895], {2}: [0.4441530317, 0.1156563438, 0.9995708517, 0.1970799147, 0.6918476601, 0.09993579457, 0.5845890403], {3}: [0.9152493746, 0.115467513, 0.9988965683, 0.1959078792, 0.593176374, 0.6374284051, 0.5817666967], {4}: [0.1888914975, 0.1160008995, 0.9993218109, 0.1964554784, 0.5919666984, 0.3408859217, 0.7279703993], {5}: [0.9132539312, 0.8749213374, 0.9998682158, 0.1967917312, 0.6918217971, 0.09944351487, 0.8327774061]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))

# ---- group: Example Historic Data
num_5 = Number(Tree({0;0;0}: [0.55239706, 0.4646391694, 0.2318116977, 0.00657430664, 0.678519524, 0.003749547528, 0.3820717155], {0;0;1}: [0.7928806477, 0.8917642645, 0.8481872696, 0.9107162114, 0.7645069369, 0.4208457439, 0.7912640892], {0;0;2}: [0.1721039192, 0.7559592178, 0.6718950931, 0.8524837181, 0.7387195014, 0.2497752925, 0.6433302707], {0;0;3}: [0.637166546, 0.8397098341, 0.0202827938, 0.1866106313, 0.625952977, 0.7161322612, 0.9297328591], {0;0;4}: [0.5265048265, 0.3884976108, 0.5029038473, 0.9737291066, 0.07493799649, 0.4726874705, 0.9976634844], {0;0;5}: [0.874312194, 0.8983247722, 0.4976757939, 0.183298525, 0.7346817324, 0.1774099237, 0.9750488256]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))

# ----
split = SplitTree(Data=num_5, Masks=flatten(panel))  # -> Positive, Negative

# ---- group: Biomorpher Reader component
biomorpherreader = BiomorpherReader(GenoGuids=id_2, Population=split.Positive, DesignID=Slider(66, range=0..99))
