# Grasshopper definition QuadtreeExtrusions.gh (Grasshopper 0.9.76)
# plug-ins: Biomorpher

genes = GenePool(
    Decimals=2,
    Maximum=100,
    Minimum=0,
    Value=[94.7352299, 50.12391864, 70.89128227, 82.8010227, 55.98865843, 2.003698611, 6.990037769, 30.10005082, 15.41246754, 23.49083718, 56.67130861, 70.65180799, 50.50540201, 80.01838125, 16.33111682, 83.90621896, 71.82480324, 31.22838765, 46.90229806, 71.75916493])
genes_2 = GenePool(
    Decimals=2,
    Maximum=50,
    Minimum=0,
    Value=[10.22322842, 35.21728811, 11.97598866, 20.6247307, 44.79780616, 39.62233448, 36.99865904, 4.334762438, 46.08129926, 4.544036046, 47.68041912, 22.35876367, 39.46041101, 39.75379127, 24.4450044, 41.85625077, 10.32042495, 6.48191064, 15.21929273, 8.025761744])
# In this example, genepools are used to
# create planar curves that are then extruded.
# Double click on the biomorpher component to begin.
genes_3 = GenePool(
    Decimals=2,
    Maximum=100,
    Minimum=0,
    Value=[33.83642018, 91.53213217, 95.76484398, 86.42724389, 18.0552221, 25.88028052, 6.330273303, 6.202837688, 61.49310584, 71.72653017, 24.79543496, 10.39141268, 2.753946093, 94.2147871, 16.96990035, 93.41142643, 91.4018955, 43.0612582, 47.76466258, 9.06864163])
pt = ConstructPoint(XCoordinate=genes_3, YCoordinate=genes, ZCoordinate=0)
qt = QuadTree(Points=pt, Plane=PlaneXY(0, 0, 0), Square=False, Group=Slider(1, range=0..10))  # -> Quads, Points
runion = RegionUnion(Curves=qt.Quads)
fillet = Fillet(Curve=runion, Radius=Slider(2.5, range=0..10))
lng = ListLength(List=fillet)
split = SplitList(List=genes_2, Index=lng)  # -> ListA, ListB
Z = UnitZ(Factor=split.ListA)
extr = Extrude(Base=fillet, Direction=Z)
cap = CapHoles(Brep=extr)
smooth = SettingsQuality()
mesh = MeshBrep(Brep=cap, Settings=smooth)
lng_2 = ListLength(List=mesh)
random = Random(Range=Domain(0, 1), Number=lng_2, Seed=2)
random_2 = Random(Range=Domain(0, 1), Number=lng_2, Seed=3)
random_3 = Random(Range=Domain(0, 1), Number=lng_2, Seed=4)
frgb = ColourRGBF(Alpha=1, Red=random, Green=random_2, Blue=random_3)
mcol = MeshColours(Mesh=graft(mesh), Colours=graft(frgb))
preview = CustomPreview(Geometry=cap, Shader=frgb)
volume = Volume(Geometry=mcol)  # -> flatten(Volume), Centroid
ma = MassAddition(Input=volume.Volume)  # -> Result, PartialResults
biomorpher = Biomorpher(Genome=[genes_3, genes, genes_2], MeshEs=mcol, Performance=ma.Result)  # -> GenoGuids, Population, Historic, Clusters

# ---- group: Try an initial population
num = Number(Tree({0}: [0.1318837181, 0.1220438495, 0.4482882276, 0.6958550581, 0.6418843296, 0.2590407195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], {1}: [0.4151497532, 0.434424605, 0.2929050086, 0.1997524966, 0.6112884593, 0.7778038959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], {2}: [0.09769629319, 0.7615103762, 0.6158182158, 0.6702732177, 0.2074497227, 0.5578652795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], {3}: [0.9713377855, 0.5266667025, 0.6600308426, 0.801374711, 0.7045073568, 0.1616930487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], {4}: [0.9434405453, 0.29806923, 0.5641738361, 0.4279576984, 0.5799704094, 0.4454123468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], {5}: [0.09924853924, 0.6915303528, 0.7202166443, 0.391575779, 0.8111520404, 0.8143718149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]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))
