# Grasshopper definition Turtle.gh (Grasshopper 0.9.76)
# plug-ins: Biomorpher

genes = GenePool(
    Decimals=0,
    Maximum=3,
    Minimum=0,
    Value=[2.225496581, 1.687952735, 0.3720658452, 2.051377754, 0.3904482078, 0.9085192641, 0.3396191092, 0.3474380594, 1.926969705, 2.523236841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])
genes_2 = GenePool(
    Decimals=0,
    Maximum=3,
    Minimum=0,
    Value=[1.211717694, 0.7107122445, 1.864778333, 1.773297209, 2.583165721, 2.583456407, 0.2021558614, 2.27720581, 0.5332573598, 1.349142218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])
genes_3 = GenePool(
    Decimals=0,
    Maximum=3,
    Minimum=0,
    Value=[1, 1.102773114, 1.304211031, 2.294987025, 2.615721914, 0.06148327715, 0.552036394, 2.113672292, 1.200397521, 0.9303284095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])
entwine = Entwine(Branch00=genes_3, Branch01=genes, Branch02=genes_2, FlattenInputs=True)
c_script = CSharpScript(x=Slider(0, range=0..10), y=Slider(0, range=0..10), z=entwine)  # -> out, A; inputs x: Int32, y: Int32, z: list of Int32
# ---------- c_script: C# ----------
    List<Point3d> pts = new List<Point3d>();

    int currentX = x;
    int currentY = y;

    pts.Add(new Point3d(currentX, currentY, 0));

    for(int i = 0; i < z.Count; i++)
    {
      switch(z[i])
      {
        case 0:
          currentX++;
          break;
        case 1:
          currentY++;
          break;
        case 2:
          currentX--;
          break;
        case 3:
          currentY--;
          break;
      }

      pts.Add(new Point3d(currentX, currentY, 0));
    }


    Polyline myPoly = new Polyline(pts);
    A = myPoly;
# ---------- end c_script ----------
fillet = Fillet(Curve=flatten(c_script.A), Radius=Slider(0.5, range=0..1))
Z = UnitZ(Factor="0.5")
extr = Extrude(Base=fillet, Direction=Z)
len = Length(Curve=fillet)
panel = Panel("""magenta
orange
grey""")
mesh = Mesh(extr)
ma = MassAddition(Input=len)  # -> TotalLength, PartialResults
mcol = MeshColours(Mesh=graft(mesh), Colours=graft(panel))
area = Area(Geometry=extr)  # -> Area, Centroid
biomorpher = Biomorpher(Genome=[genes_3, genes, genes_2], MeshEs=mcol, Performance=ma.TotalLength)  # -> GenoGuids, Population, Historic, Clusters
