# Grasshopper definition UntangleThread.gh (Grasshopper 0.9.76)
# plug-ins: Biomorpher

# Try to untangle a thread.
# This is a very tricky problem to set an objective function
# (i.e. using Galapagos), but easier if a human can judge
# success at each generation.
# Double click on the biomorpher component to begin.
# Needs meshpipe component.
genes = GenePool(
    Decimals=2,
    Maximum=100,
    Minimum=-100,
    Value=[8.824902358, -80.03228865, -47.64474712, 81.22436422, 28.97509203, -67.90953305, 81.77593778, 77.60733439, 36.73489556, -83.40290346])
genes_2 = GenePool(
    Decimals=2,
    Maximum=100,
    Minimum=-100,
    Value=[-21.72547333, -58.46663069, 48.09394271, -19.82221805, 78.21502405, -12.15557219, -28.85987662, 50.87099818, 52.35570732, 31.84033406])
genes_3 = GenePool(
    Decimals=2,
    Maximum=100,
    Minimum=0,
    Value=[23.86207549, 31.54951363, 21.91631655, 89.56559984, 13.72747804, 71.79919433, 80.25215449, 62.06733098, 83.98825954, 23.54178569])
pt = ConstructPoint(XCoordinate=genes, YCoordinate=genes_2, ZCoordinate=genes_3)
intcrv = Interpolate(Vertices=pt, Degree=3, Periodic=True, KnotStyle=1)  # -> Curve, Length, Domain
divide = DivideCurve(Curve=intcrv.Curve, Count=Slider(100, range=0..100), Kinks=False)  # -> Points, Tangents, Parameters
curvature = Curvature(Curve=intcrv.Curve, Parameter=divide.Parameters)  # -> P, K, C
unit = UnitVector(Vector=curvature.K)
vdisex = VectorDisplayEx(Point=curvature.P, Vector=expr("x*100", curvature.K), Colour=RGB(0, 0, 0), Width=2)

# ---- group: Variance of curvature
vlen = VectorLength(Vector=curvature.K)
cluster = Cluster(num=vlen)

# ----
line = LineSDL(Start=curvature.P, Direction=unit, Length=Slider(6, range=0..10))
loft = Loft(Curves=line, Options={Adjust=False, Closed=True, LoftEnds=0, LoftSimp=0, LoftType=0, Rebuild=10, Refit=0.01})
preview = CustomPreview(
    Geometry=loft,
    Shader={ambient=RGB(0, 0, 0), diffuse=RGB(255, 105, 180), emission=RGB(76, 32, 54), shine=0.5, specular=RGB(255, 255, 255), transparency=0})
mesh_uv = MeshSurface(Surface=loft, UCount=200, VCount=5, Overhang=True, Equalize=False)
biomorpher = Biomorpher(Genome=[genes, genes_2, genes_3], MeshEs=mesh_uv, Performance=[cluster, intcrv.Length])  # -> GenoGuids, Population, Historic, Clusters

# ==== cluster Cluster
num = ClusterInput()
num_2 = Number(num)
avr = Average(Input=num_2)
subtraction = Subtraction(A=avr, B=num_2)
lng = ListLength(List=num_2)
sqr = Square(Value=subtraction)
ma = MassAddition(Input=sqr)  # -> Result, PartialResults
division = Division(A=ma.Result, B=lng)
R = ClusterOutput(division)
