# Grasshopper definition turtle.gh (Grasshopper 0.9.76)
# plug-ins: Biomorpher

genes = GenePool(
    Decimals=0,
    Maximum=3,
    Minimum=0,
    Value=[0.5095747666, 2.195127738, 2.962490586, 1.671877463, 1.874160507, 1.881953004, 0.1436934211, 2.767328063, 1.74163946, 2.948553015, 0.9099312231, 1.193677354, 0.6192006348, 0.2426461242, 2.642546677, 2.936121193, 1.674526411, 1.97359636, 2.311640671, 2.031882421])
genes_2 = GenePool(
    Decimals=0,
    Maximum=3,
    Minimum=0,
    Value=[2.613801395, 0.2462057705, 0.6772162172, 2.690230601, 2.528448929, 2.688160215, 1.558615548, 0.4300605625, 0.7875383987, 0.7974698701, 2.43069628, 1.375377963, 2.119473662, 0.4520825403, 2.692829728, 1.28340909, 0.3150957533, 2.772172359, 2.949117989, 2.647366277])
entwine = Entwine(Branch00=genes_2, Branch01=genes, FlattenInputs=True)
panel = Panel("""1
2""")
c_script = CSharpScript(x=Slider(0, range=0..10), y=Slider(0, range=0..10), z=entwine)  # -> out, A; inputs x: Int32, y: Int32, z: list of Int32
# ---------- c_script: C# ----------
    List<Point3d> pts = new List<Point3d>();

    int currentX = x;
    int currentY = y;

    pts.Add(new Point3d(currentX, currentY, 0));

    for(int i = 0; i < z.Count; i++)
    {
      switch(z[i])
      {
        case 0:
          currentX++;
          break;
        case 1:
          currentY++;
          break;
        case 2:
          currentX--;
          break;
        case 3:
          currentY--;
          break;
      }

      pts.Add(new Point3d(currentX, currentY, 0));
    }


    Polyline myPoly = new Polyline(pts);
    A = myPoly;
# ---------- end c_script ----------
fillet = Fillet(Curve=flatten(c_script.A), Radius=Slider(0.2, range=0..1))
Z = UnitZ(Factor=panel)
panel_2 = Panel("""magenta
orange""")
extr = Extrude(Base=fillet, Direction=Z)
mesh = Mesh(extr)
mcol = MeshColours(Mesh=graft(mesh), Colours=graft(panel_2))
area = Area(Geometry=extr)  # -> Area, Centroid
biomorpher = Biomorpher(Genome=[genes_2, genes], Geometry=mcol, Performance=area.Area)  # -> GenoGuids, Population, Historic, Clusters
