# Grasshopper definition untangle.gh (Grasshopper 0.9.76)
# plug-ins: Biomorpher, Mesh Pipe

# Try to untangle the nurbs curve using biomorpher...
genes = GenePool(
    Decimals=2,
    Maximum=100,
    Minimum=0,
    Value=[4.297270209, 7.59024951, 83.02531116, 9.217804954, 55.81018923, 26.89067839, 90.90890958, 78.06820561, 80.39207341, 18.30517562])
genes_2 = GenePool(
    Decimals=2,
    Maximum=100,
    Minimum=0,
    Value=[8.540556351, 27.97079302, 97.75742656, 20.36759864, 80.03594851, 63.85085954, 24.56676491, 19.92168623, 71.72425057, 19.05519707])
genes_3 = GenePool(
    Decimals=2,
    Maximum=100,
    Minimum=0,
    Value=[17.35732593, 14.07101122, 18.79635445, 83.24775173, 42.1323864, 72.15965333, 12.5135108, 51.07527964, 94.42755198, 15.52099353])
pt = ConstructPoint(XCoordinate=genes, YCoordinate=genes_2, ZCoordinate=genes_3)
nurbs = NurbsCurve(Vertices=pt, Degree=3, Periodic=True)  # -> Curve, Length, Domain
mpipe = MeshPipe(Curve=nurbs.Curve, Radius="1", Accuracy=0.2, Rotation=0, Segments=10, Caps=2)
biomorpher = Biomorpher(Genome=[genes, genes_2, genes_3], Geometry=mpipe)
