# Grasshopper definition untanglethread.gh (Grasshopper 0.9.76)
# plug-ins: Biomorpher, Mesh Pipe

# Try to untangle a thread.
# This is a very tricky problem to set an objective function
# (i.e. using Galapagos), but easier if a human can judge
# success at each generation.
# Double click on the biomorpher component to begin.
# Needs meshpipe component.
genes = GenePool(
    Decimals=2,
    Maximum=100,
    Minimum=0,
    Value=[36.91330683, 44.10633366, 94.47765623, 20.76159138, 63.53779874, 12.89009531, 77.75086794, 54.28727528, 13.81856634, 18.43537133])
genes_2 = GenePool(
    Decimals=2,
    Maximum=100,
    Minimum=0,
    Value=[22.15829192, 58.15625469, 94.21194627, 3.458953122, 10.06630166, 27.1164595, 13.30933433, 24.45936299, 25.21719327, 7.383312304])
genes_3 = GenePool(
    Decimals=2,
    Maximum=100,
    Minimum=0,
    Value=[22.43594429, 90.28596945, 19.67580387, 25.90497813, 15.95013818, 50.0480658, 28.81002637, 33.37480713, 36.17054032, 19.31220231])
pt = ConstructPoint(XCoordinate=genes, YCoordinate=genes_2, ZCoordinate=genes_3)
nurbs = NurbsCurve(Vertices=pt, Degree=3, Periodic=True)  # -> Curve, Length, Domain
len = Length(Curve=nurbs.Curve)
mpipe = MeshPipe(Curve=nurbs.Curve, Radius="1", Accuracy=0.2, Rotation=0, Segments=10, Caps=2)
biomorpher = Biomorpher(Genome=[genes, genes_2, genes_3], Geometry=mpipe, Performance=len)  # -> Clusters, Population, Historic, Clusters_2
